# Grasshopper definition srf_analysis.gh (Grasshopper 1.0.8)
# plug-ins: Pufferfish, LunchBox

mesh = Mesh(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)
offset_mesh = OffsetMesh(Mesh=mesh, Distance=Slider(0.4, range=0..1), BothSides=0, CreateSolid=Toggle(False))

# ---- group: cells_definition
mesh_to_nurbs = MeshToNurbs(Mesh=offset_mesh)  # -> QuadrangularSurfaces, TriangularSurfaces
area = Area(Geometry=mesh_to_nurbs.TriangularSurfaces)  # -> Area, Centroid
evaluate_surface = EvaluateSurface(Surface=mesh_to_nurbs.TriangularSurfaces, Point=area.Centroid)  # -> Point, Normal, UDirection, VDirection, Frame
construct_plane = ConstructPlane(Origin=area.Centroid, XAxis=evaluate_surface.UDirection, YAxis=evaluate_surface.VDirection)
bounding_box = BoundingBox(Content=graft(mesh_to_nurbs.TriangularSurfaces), Plane=graft(construct_plane))  # -> Box, Box_2
number_slider = Slider(0, range=0..3)
deconstruct_brep = DeconstructBrep(Brep=bounding_box.Box)  # -> Faces, Edges, Vertices
number_slider_2 = Slider(5, range=0..10)
number_slider_3 = Slider(0.6, range=0..10)
number_slider_4 = Slider(20, range=0..150)
list_item = ListItem(List=deconstruct_brep.Vertices, Index="0", Wrap=True)
construct_plane_2 = ConstructPlane(Origin=flatten(list_item), XAxis=evaluate_surface.UDirection, YAxis=evaluate_surface.VDirection)
multiplication = Multiplication(A=number_slider_3, B="3")
power = Power(A=number_slider_4, B="2")
rectangular = Rectangular(Plane=construct_plane_2, SizeX=number_slider_3, SizeY=multiplication, ExtentX=number_slider_4, ExtentY=number_slider_4)  # -> simplify(Cells), Points

# ----
dimensions = Dimensions(Surface=bounding_box.Box)  # -> UDimension, VDimension
division = Division(A=dimensions.UDimension, B=number_slider_3)
division_2 = Division(A=dimensions.VDimension, B=multiplication)
addition = Addition(A=division, B="1")
addition_2 = Addition(A=division_2, B="1")
round = Round(Number=addition)  # -> Nearest, Floor, Ceiling
round_2 = Round(Number=addition_2)  # -> Nearest, Floor, Ceiling
rectangular_2 = Rectangular(
    Plane=simplify(graft(construct_plane_2)),
    SizeX=number_slider_3,
    SizeY=multiplication,
    ExtentX=simplify(round.Ceiling),
    ExtentY=simplify(round_2.Ceiling))  # -> simplify(Cells), Points
multiplication_2 = Multiplication(A=round.Ceiling, B=round_2.Ceiling)  # -> simplify(Result)

# ---- group: cells_definition (continued)
surface = Surface(rectangular_2.Cells)

# ----
surface_2 = Surface(rectangular_2.Cells)
list_length = ListLength(List=multiplication_2)  # -> flatten(Length)

# ---- group: til
deconstruct_plane = DeconstructPlane(Plane=construct_plane_2)  # -> Origin, XAxis, YAxis, simplify(graft(ZAxis))
deconstruct_brep_2 = DeconstructBrep(Brep=flatten(surface))  # -> Faces, Edges, Vertices
join_curves = JoinCurves(Curves=deconstruct_brep_2.Edges, Preserve=False)  # -> flatten(Curves)
partition_list = PartitionList(List=join_curves, Size=flatten(multiplication_2))  # -> simplify(Chunks)
surface_3 = Surface(simplify(graft(mesh_to_nurbs.TriangularSurfaces)))
panel = Panel(surface_3)
panel_2 = Panel(partition_list)
panel_3 = Panel(deconstruct_plane.ZAxis)
project_curve = ProjectCurve(Curve=partition_list, Brep=surface_3, Direction=panel_3)
trim_tree = TrimTree(Tree=project_curve, Depth="1")
panel_4 = Panel(trim_tree)
surface_split = SurfaceSplit(Surface=surface_3, Curves=trim_tree)

# ----
explode = Explode(Curve=trim_tree, Recursive=True)  # -> Segments, Vertices
trim_tree_2 = TrimTree(Tree=explode.Segments, Depth=1)
panel_5 = Panel(trim_tree_2)
join_curves_2 = JoinCurves(Curves=trim_tree, Preserve=False)

# ---- group: panels
construct_domain = ConstructDomain(DomainStart="0", DomainEnd="90")
area_2 = Area(Geometry=surface_split)  # -> Area, Centroid
deconstruct = Deconstruct(Point=area_2.Centroid)  # -> XComponent, YComponent, ZComponent
larger_than = LargerThan(FirstNumber=deconstruct.ZComponent, SecondNumber=Slider(38, range=0..100))  # -> LargerThan, OrEqualTo
jitter = Jitter(List=larger_than.LargerThan, Jitter=Slider(0.04, range=0..1), Seed=2)  # -> Values, Indices
dispatch = Dispatch(List=surface_split, DispatchPattern=jitter.Values)  # -> ListA, ListB
surface_4 = Surface(dispatch.ListB)
surface_5 = Surface(dispatch.ListA)
random_split_list = RandomSplitList(MasterList=surface_4, Seed=2, Split=0.5)  # -> ListA, ListB
random_split_list_2 = RandomSplitList(MasterList=surface_5, Seed=2, Split=Slider(0.2, range=0..1))  # -> ListA, ListB
random_split_list_3 = RandomSplitList(MasterList=random_split_list.ListA, Seed=2, Split=0.5)  # -> ListA, ListB
random_split_list_4 = RandomSplitList(MasterList=random_split_list.ListB, Seed=2, Split=0.5)  # -> ListA, ListB
surface_6 = Surface(random_split_list_2.ListB)
surface_7 = Surface(random_split_list_2.ListA)
list_length_2 = ListLength(List=flatten(surface_7))
random = Random(Range=construct_domain, Number=list_length_2, Seed=2)
data = Data(simplify(flatten(random)))
partition_list_2 = PartitionList(List=data, Size="1")  # -> simplify(Chunks)
area_3 = Area(Geometry=surface_7)  # -> Area, Centroid
surface_8 = Surface(simplify(flatten(surface_7)))
partition_list_3 = PartitionList(List=surface_8, Size="1")  # -> simplify(Chunks)
surface_9 = Surface(random_split_list_3.ListA)
surface_10 = Surface(random_split_list_3.ListB)
surface_11 = Surface(random_split_list_4.ListA)
surface_12 = Surface(random_split_list_4.ListB)
evaluate_surface_2 = EvaluateSurface(Surface=surface_7, Point=area_3.Centroid)  # -> Point, Normal, UDirection, VDirection, Frame
panel_7 = Panel(partition_list_2)
construct_plane_3 = ConstructPlane(Origin=area_3.Centroid, XAxis=evaluate_surface_2.UDirection, YAxis=evaluate_surface_2.VDirection)
radians = Radians(Degrees=partition_list_2)
deconstruct_plane_2 = DeconstructPlane(Plane=construct_plane_3)  # -> Origin, XAxis, YAxis, ZAxis
construct_plane_4 = ConstructPlane(Origin=deconstruct_plane_2.Origin, XAxis=deconstruct_plane_2.ZAxis, YAxis=deconstruct_plane_2.XAxis)
data_2 = Data(simplify(flatten(construct_plane_4)))
partition_list_4 = PartitionList(List=data_2, Size="1")  # -> simplify(Chunks)
panel_8 = Panel(partition_list_4)
rotate = Rotate(Geometry=partition_list_3, Angle=radians, Plane=partition_list_4)  # -> Geometry, Transform

# ----
mesh_2 = Mesh(rotate.Geometry)
mesh_3 = Mesh(surface_6)

mesh_4 = Mesh(surface_9)
mesh_5 = Mesh(surface_10)
mesh_6 = Mesh(surface_11)
mesh_7 = Mesh(surface_12)

curve = Curve(trim_tree)
mesh_8 = Mesh(flatten(mesh_2))
join_curves_3 = JoinCurves(Curves=flatten(curve), Preserve=False)

curve_2 = Curve(trim_tree)
explode_2 = Explode(Curve=curve_2, Recursive=True)  # -> flatten(Segments), Vertices
perp_frame = PerpFrame(Curve=reparameterize(join_curves_3), Parameter="0")
rectangle = Rectangle(Plane=PlaneXY(0, 0, 0), XSize=Slider(0.05, range=0..0.1), YSize=Slider(0.03, range=0..0.1), Radius=0)  # -> Rectangle, Length
area_4 = Area(Geometry=rectangle.Rectangle)  # -> Area, Centroid
orient = Orient(Geometry=rectangle.Rectangle, Source=area_4.Centroid, Target=perp_frame)  # -> Geometry, Transform
panel_9 = Panel(explode_2.Segments)
panel_10 = Panel(orient.Geometry)

area_5 = Area(Geometry=mesh_4)  # -> Area, Centroid
area_6 = Area(Geometry=mesh_5)  # -> Area, Centroid
area_7 = Area(Geometry=mesh_6)  # -> Area, Centroid
area_8 = Area(Geometry=mesh_7)  # -> Area, Centroid
number_slider_5 = Slider(0.98, range=0..1)
scale = Scale(Geometry=mesh_4, Center=area_5.Centroid, Factor=number_slider_5)  # -> Geometry, Transform
scale_2 = Scale(Geometry=mesh_5, Center=area_6.Centroid, Factor=number_slider_5)  # -> Geometry, Transform
scale_3 = Scale(Geometry=mesh_6, Center=area_7.Centroid, Factor=number_slider_5)  # -> Geometry, Transform
scale_4 = Scale(Geometry=mesh_7, Center=area_8.Centroid, Factor=number_slider_5)  # -> Geometry, Transform
number_slider_6 = Slider(0.1, range=0..0.1)
number_slider_7 = Slider(0.05, range=0..0.1)
offset_mesh_2 = OffsetMesh(Mesh=mesh_2, Distance=number_slider_6, BothSides=0, CreateSolid=True)
offset_mesh_3 = OffsetMesh(Mesh=mesh_3, Distance=number_slider_6, BothSides=0, CreateSolid=True)
offset_mesh_4 = OffsetMesh(Mesh=scale.Geometry, Distance=number_slider_7, BothSides=0, CreateSolid=True)
offset_mesh_5 = OffsetMesh(Mesh=scale_2.Geometry, Distance=number_slider_7, BothSides=0, CreateSolid=True)
offset_mesh_6 = OffsetMesh(Mesh=scale_3.Geometry, Distance=number_slider_7, BothSides=0, CreateSolid=True)
offset_mesh_7 = OffsetMesh(Mesh=scale_4.Geometry, Distance=Slider(0.1, range=0..0.2), BothSides=0, CreateSolid=True)

panel_11 = Panel(mesh_8)
panel_12 = Panel(join_curves_3)
python_3_script = Python3Script(curves=join_curves_3, square_dimension=Slider(0.1, range=0..0.1))  # -> a; inputs curves: Curve, square_dimension: Double
# ---------- python_3_script: Python ----------
import Rhino.Geometry as rg

# --- PARAMETER BLOCK ---
# Material properties
material_color = (200, 200, 200)
material_roughness = 0.8

# Camera settings
camera_fov = 60.0
camera_target = rg.Point3d(0, 0, 0)

# Post-process effects
post_process_bloom = False
post_process_ao = True

# Geometry Settings 
default_sq_dim = 0.2
# -----------------------

def create_lightweight_structure(curves_list, sq_dim):
    mesh_list = []
    
    # Use fallback if sq_dim is not provided
    if not sq_dim:
        sq_dim = default_sq_dim
        
    # SAFETY CHECK: If input is a single item instead of a list, wrap it
    if isinstance(curves_list, rg.Curve):
        curves_list = [curves_list]
        
    # Calculate half-thickness from the full square dimension
    thickness = sq_dim / 2.0 
    
    for crv in curves_list:
        if not crv: continue
        
        # Break polyline into individual straight segments
        segments = crv.DuplicateSegments()
        
        # Fallback in case it's a simple line and DuplicateSegments returns nothing
        if not segments:
            segments = [crv]
            
        for seg in segments:
            p1 = seg.PointAtStart
            p2 = seg.PointAtEnd
            
            # Calculate vector 
            vec = p2 - p1
            if vec.Length < 0.001: continue
            
            # Create a plane perpendicular to the line segment
            plane = rg.Plane(p1, vec)
            
            # Create a simple box aligned to the segment
            interval = rg.Interval(-thickness, thickness)
            height_interval = rg.Interval(0, vec.Length)
            
            box = rg.Box(plane, interval, interval, height_interval)
            
            # Convert to Mesh for maximum efficiency
            m = rg.Mesh.CreateFromBox(box, 1, 1, 1)
            mesh_list.append(m)

    return mesh_list

# Assign output
if 'curves' in globals():
    dim_input = square_dimension if 'square_dimension' in globals() else None
    a = create_lightweight_structure(curves, dim_input)
# ---------- end python_3_script ----------

data_3 = Data(offset_mesh_2)
data_4 = Data(offset_mesh_3)

data_5 = Data(offset_mesh_4)
data_6 = Data(offset_mesh_5)
data_7 = Data(offset_mesh_6)
data_8 = Data(offset_mesh_7)

mesh_9 = Mesh(python_3_script)
list_length_3 = ListLength(List=flatten(data_7))  # -> flatten(Length)
list_length_4 = ListLength(List=flatten(data_3))  # -> flatten(Length)
list_length_5 = ListLength(List=flatten(data_8))  # -> flatten(Length)
list_length_6 = ListLength(List=flatten(data_4))  # -> flatten(Length)
list_length_7 = ListLength(List=flatten(data_5))  # -> flatten(Length)
list_length_8 = ListLength(List=flatten(data_6))  # -> flatten(Length)
panel_13 = Panel(list_length_3)
panel_14 = Panel(list_length_5)
panel_15 = Panel(list_length_4)
panel_16 = Panel(list_length_6)
volume = Volume(Geometry=flatten([data_3, data_4]))  # -> Volume, Centroid
volume_2 = Volume(Geometry=flatten([data_5, data_6, data_7, data_8]))  # -> Volume, Centroid
panel_17 = Panel(list_length_7)
panel_18 = Panel(list_length_8)
mass_addition = MassAddition(Input=flatten(volume.Volume))  # -> Result, PartialResults
mass_addition_2 = MassAddition(Input=[panel_17, panel_18, panel_13, panel_14])  # -> Result, PartialResults
mass_addition_3 = MassAddition(Input=flatten(volume_2.Volume))  # -> Result, PartialResults
mass_addition_4 = MassAddition(Input=[panel_15, panel_16])  # -> Result, PartialResults
panel_19 = Panel(mass_addition_2.Result)
panel_20 = Panel(mass_addition.Result)
panel_21 = Panel(mass_addition_4.Result)
panel_22 = Panel(mass_addition_3.Result)
multiplication_3 = Multiplication(A=panel_22, B="2700")
multiplication_4 = Multiplication(A=panel_20, B="3000")
panel_23 = Panel(multiplication_3)
panel_24 = Panel(multiplication_4)
multiplication_5 = Multiplication(A=panel_23, B="0.08")
multiplication_6 = Multiplication(A=panel_24, B="2.2")
panel_25 = Panel(multiplication_5)
panel_26 = Panel(multiplication_6)
